# Dynamo graph darBienvenida.dyn (Dynamo 2.19.3.6394)

# group: DesignScript
# El código puede ser copiado desde cualquier repositorio (GitHub).
code_block = CodeBlock()
# ---------- code_block.designscript (4 lines) ----------
def darBienvenida(nombre : string)
{
    return "Bienvenid@ a BIMFRASummit'24, " + nombre;
};
# ----------------------------------------
code_block_2 = CodeBlock { darBienvenida("Juan"); }
code_block_3 = CodeBlock { darBienvenida("Maria"); }

# group: Desde Fichero
nombre_archivo = StringInput("darBienvenida.py")
nombre = StringInput("Juan")
python_script = Python(IN[0]=nombre_archivo, IN[1]=nombre)  # CPython3
# ---------- python_script.python (18 lines) ----------
import sys
import getpass

# Retrieve the current user's name
userName = getpass.getuser()

# Get the file name from the input
fileName = IN[0]
nombre= IN[1]

# Construct the file path using the retrieved username and the provided file name
filePath = f'C:\\Users\\{userName}\\Desktop\\{fileName}'

sys.path.append(filePath)

from darBienvenida import *

OUT = darBienvenida(IN[1])
# ----------------------------------------
